# Grasshopper definition guide.gh (Grasshopper 1.0.7)

# Set the number of the quad-mesh
number_slider = Slider(225, range=0..1000)
# Set the number of the quad-mesh
number_slider_2 = Slider(200, range=0..1000)
# 1. Set curves from Rhino into the component
panel = Panel("Bacis")
# 1. Set a planar closed curve from Rhino into the component
panel_2 = Panel("Custom Texture Array")
# 1. Set a planar closed curve from Rhino into the component
panel_3 = Panel("Texture Array")
# a. Draw curves or polylines in Rhino.
# b. Right-click on the component and select "Set one Curve" or "Set Multiple Curves" from the panel.
crv = Curve(<curve referenced from the Rhino model>)
crv_2 = Curve(<curve referenced from the Rhino model>)
# Set planar curves from Rhino into the component as a texture unit
crv_3 = Curve([<curve referenced from the Rhino model> x4])
crv_4 = Curve(<curve referenced from the Rhino model>)
number_slider_3 = Slider(0.2, range=0..1)
number_slider_4 = Slider(0.2, range=0..1)
panel_4 = Panel("2. Generate texture curves")
wavy = WavyStructure(contour_curve=crv_4, tc=number_slider)  # -> flatten(output_curve_texture)
# 2. Generate custom texture curves
customt = CustomTexture(contour_curve=crv_2, target_count=number_slider_2, factor=0.5, unit_texture=crv_3, rotate_texture=0)  # -> flatten(output_curve_texture)
number_slider_5 = Slider(0.2, range=0..1)
panel_5 = Panel("3. Path Optimization")
local_optimization = LocalPathOptimization(curves=wavy)  # -> curves_2, travel_distance
panel_6 = Panel("2. Set Multi-layerd paths")
number_slider_6 = Slider(256, range=0..1000)
local_optimization_2 = LocalPathOptimization(curves=customt)  # -> curves_2, travel_distance
multi_layer = MultiLayer(
    curves=crv,
    first_layer_thickness=number_slider_3,
    top_layer_thickness=number_slider_3,
    layer_thickness=number_slider_3,
    layer_count=Slider(2, range=0..10))
panel_8 = Panel("4. Set Multi-layerd paths")
multi_layer_2 = MultiLayer(
    curves=local_optimization.curves_2,
    first_layer_thickness=number_slider_4,
    top_layer_thickness=number_slider_4,
    layer_thickness=number_slider_4,
    layer_count=Slider(2, range=0..10))
number_slider_7 = Slider(256, range=0..1000)
number_slider_8 = Slider(256, range=0..1000)
multi_layer_3 = MultiLayer(
    curves=local_optimization_2.curves_2,
    first_layer_thickness=number_slider_5,
    top_layer_thickness=number_slider_5,
    layer_thickness=number_slider_5,
    layer_count=Slider(2, range=0..10))
gcode_solver = GcodeSolver(
    platform_of_x=number_slider_6,
    platform_of_y=number_slider_6,
    platform_temperature=50,
    travel_speed=300,
    printing_speed_for_first_layer=40,
    printing_speed_for_other_layer=60,
    line_width=0.4,
    overlapping_ratio=0.05,
    material_diameter=1.75,
    nozzle_temprature=205,
    retraction_length=0.4,
    lift_z=0,
    gcode_style=0)  # -> gcode, layer_count, printing_time, platform, printing_path, travel_path
panel_10 = Panel("5. Set printing parameters")
panel_11 = Panel("3. Set printing parameters")
gcode_solver_2 = GcodeSolver(
    platform_of_x=number_slider_8,
    platform_of_y=number_slider_8,
    platform_temperature=50,
    travel_speed=300,
    printing_speed_for_first_layer=40,
    printing_speed_for_other_layer=60,
    line_width=0.4,
    overlapping_ratio=0.05,
    material_diameter=1.75,
    nozzle_temprature=205,
    retraction_length=0.4,
    lift_z=0,
    gcode_style=0)  # -> gcode, layer_count, printing_time, platform, printing_path, travel_path
gcode_solver_3 = GcodeSolver(
    platform_of_x=number_slider_7,
    platform_of_y=number_slider_7,
    platform_temperature=50,
    travel_speed=300,
    printing_speed_for_first_layer=40,
    printing_speed_for_other_layer=60,
    line_width=0.4,
    overlapping_ratio=0.05,
    material_diameter=1.75,
    nozzle_temprature=205,
    retraction_length=0.4,
    lift_z=0,
    gcode_style=0)  # -> gcode, layer_count, printing_time, platform, printing_path, travel_path

# ---- group: Click to save
button = Button()

button_2 = Button()

button_3 = Button()

# ----
panel_13 = Panel("6. Save as file")
export = ExportGcode(gcode_text=gcode_solver.gcode, path_folder="D:\FreeSlicer\gcode", file_name="path", confirm_export=button)
panel_14 = Panel("4. Save as file")
export_2 = ExportGcode(gcode_text=gcode_solver_3.gcode, path_folder="D:\FreeSlicer\gcode", file_name="path", confirm_export=button_3)
export_3 = ExportGcode(gcode_text=gcode_solver_2.gcode, path_folder="D:\FreeSlicer\gcode", file_name="path", confirm_export=button_2)

# ==== cluster GcodeSolver: Convert curves into Gcode
platform_temperature = ClusterInput()  # default 50 degree
travel_speed = ClusterInput()  # default 100 mm/s
printing_speed_for_first_layer = ClusterInput()  # default 40 mm/s
printing_speed_for_other_layer = ClusterInput()  # default 60 mm/s
line_width = ClusterInput()  # default 0.4 mm
overlapping_ratio = ClusterInput()  # default 5%
material_diameter = ClusterInput()  # default 1.75 mm
nozzle_temprature = ClusterInput()  # default 205 degree
retraction_length = ClusterInput()  # default 0.4 mm
gcode_style = ClusterInput()  # 0 is default, 1 is Klipper
platform_of_x = ClusterInput()  # default 250 mm
platform_of_y = ClusterInput()  # default 250 mm
lift_z = ClusterInput()  # default 0 mm
printing_curves = ClusterInput()  # Input curves as list
crv = Curve(flatten(printing_curves))
int = Integer(platform_of_x)
int_2 = Integer(platform_of_y)
int_3 = Integer(platform_temperature)
num = Number(lift_z)
int_4 = Integer(printing_speed_for_first_layer)
num_2 = Number(overlapping_ratio)
num_3 = Number(material_diameter)
int_5 = Integer(nozzle_temprature)
num_4 = Number(retraction_length)
int_6 = Integer(gcode_style)
int_7 = Integer(travel_speed)
num_5 = Number(line_width)
int_8 = Integer(printing_speed_for_other_layer)
rad = Radians(Degrees="15")
python = GhPythonScript(x=int)  # -> a
# ---------- python: Python ----------
__author__ = "littlechao PC"
__version__ = "2023.08.24"

import rhinoscriptsyntax as rs

if x is None:
    x = 250

a = x
# ---------- end python ----------
python_2 = GhPythonScript(x=int_2)  # -> a; same code as python
python_3 = GhPythonScript(x=num_5)  # -> a
# ---------- python_3: Python ----------
__author__ = "littlechao PC"
__version__ = "2023.08.24"

import rhinoscriptsyntax as rs

if x is None:
    x = 0.4

a = x
# ---------- end python_3 ----------
python_4 = GhPythonScript(x=num_2)  # -> a
# ---------- python_4: Python ----------
__author__ = "littlechao PC"
__version__ = "2023.08.24"

import rhinoscriptsyntax as rs

if x is None:
    x = 0.15

a = x
# ---------- end python_4 ----------
python_5 = GhPythonScript(x=int_5)  # -> a
# ---------- python_5: Python ----------
if x is None:
    x = 205

a = x
# ---------- end python_5 ----------
python_6 = GhPythonScript(x=num_3)  # -> a
# ---------- python_6: Python ----------
if x is None:
    x = 1.75

a = x
# ---------- end python_6 ----------
python_7 = GhPythonScript(x=num)  # -> a
# ---------- python_7: Python ----------
if x is None:
    x = 0

a = x
# ---------- end python_7 ----------
python_8 = GhPythonScript(x=int_6)  # -> a
# ---------- python_8: Python ----------
if x is None:
    x = 0
if x > 0:
    x = 1
a = x
# ---------- end python_8 ----------
python_9 = GhPythonScript(x=num_4)  # -> a
# ---------- python_9: Python ----------
if x is None:
    x = 0.75

a = x
# ---------- end python_9 ----------
topoly = CurveToPolyline(Curve=flatten(crv), ToleranceDistance=0, ToleranceAngle=rad)  # -> Polyline, Segments
division = Division(A=python, B="2")
division_2 = Division(A=python_2, B="2")
python_10 = GhPythonScript(x=int_3)  # -> a
# ---------- python_10: Python ----------
__author__ = "littlechao PC"
__version__ = "2023.08.24"

import rhinoscriptsyntax as rs

if x is None:
    x = 50

a = x
# ---------- end python_10 ----------
python_11 = GhPythonScript(x=int_8)  # -> a
# ---------- python_11: Python ----------
__author__ = "littlechao PC"
__version__ = "2023.08.24"

import rhinoscriptsyntax as rs

if x is None:
    x = 60

a = x
# ---------- end python_11 ----------
python_12 = GhPythonScript(x=int_7)  # -> a
# ---------- python_12: Python ----------
__author__ = "littlechao PC"
__version__ = "2023.08.24"

import rhinoscriptsyntax as rs

if x is None:
    x = 100

a = x
# ---------- end python_12 ----------
python_13 = GhPythonScript(x=int_4)  # -> a
# ---------- python_13: Python ----------
__author__ = "littlechao PC"
__version__ = "2023.08.24"

import rhinoscriptsyntax as rs

if x is None:
    x = 40

a = x
# ---------- end python_13 ----------
addition = Addition(A=python_4, B="1")
explode = Explode(Curve=topoly.Polyline, Recursive=True)  # -> Segments, Vertices
python_14 = GhPythonScript(x=python_9)  # -> a
# ---------- python_14: Python ----------
if x != 0:
    x = 1

a = x
# ---------- end python_14 ----------
python_15 = GhPythonScript(x=python_7)  # -> a; same code as python_14
multiplication = Multiplication(A=python_3, B=addition)
pt = ConstructPoint(XCoordinate=division, YCoordinate=division_2, ZCoordinate=0)
len = Length(Curve=explode.Segments)
addition_2 = Addition(A=explode.Vertices, B=pt)
multiplication_2 = Multiplication(A=python_13, B="60")
multiplication_3 = Multiplication(A=python_11, B="60")
multiplication_4 = Multiplication(A=python_12, B="60")
split = SplitList(List=addition_2, Index="1")  # -> ListA, ListB
dom = ConstructDomain(DomainStart=expr("-x", division_2), DomainEnd=division_2)
dom_2 = ConstructDomain(DomainStart=expr("-x", division), DomainEnd=division)
pdecon = Deconstruct(Point=split.ListA)  # -> XComponent, YComponent, ZComponent

cset = CreateSet(List=flatten(pdecon.ZComponent))  # -> Set, Map
cull_i = CullIndex(List=cset.Set, Indices="0", Wrap=True)
cull_i_2 = CullIndex(List=cset.Set, Indices="-1", Wrap=True)
item = ListItem(List=cset.Set, Index=0, Wrap=True)
subtraction = Subtraction(A=cull_i, B=cull_i_2)
ins = InsertItems(List=subtraction, Item=item, Indices="0", Wrap=True)
item_2 = ListItem(List=ins, Index=cset.Map, Wrap=True)  # -> simplify(graft(Item))

lng = ListLength(List=cset.Set)
pdecon_2 = Deconstruct(Point=split.ListB)  # -> XComponent, YComponent, ZComponent
smaller = SmallerThan(FirstNumber=lng, SecondNumber="2")  # -> SmallerThan, OrEqualTo
rectangle = Rectangle(Plane=PlaneXY(0, 0, 0), XSize=dom_2, YSize=dom, Radius=0)  # -> Rectangle, Length
python_16 = GhPythonScript(z=pdecon_2.ZComponent, H=item, f1=multiplication_2, f2=multiplication_3)  # -> a; inputs f1: Int32, f2: Int32
# ---------- python_16: Python ----------
if z > H:
    a = f2
else:
    a = f1
# ---------- end python_16 ----------
filter = StreamFilter(Gate=smaller.SmallerThan, Stream0=item_2, Stream1=cset.Set)
expression = Expression(width=multiplication, high=filter, diameter=python_6, Expression="width*high/(π*(diameter/2)²)")
flatten = FlattenTree(Tree=explode.Segments, Path="{0}")
end = EndPoints(Curve=flatten)  # -> Start, End
cull_i_3 = CullIndex(List=end.Start, Indices="0", Wrap=True)
cull_i_4 = CullIndex(List=end.End, Indices="-1", Wrap=True)
multiplication_5 = Multiplication(A=len, B=expression)
ma = MassAddition(Input=flatten(multiplication_5))  # -> Result, PartialResults
ln = Line(StartPoint=cull_i_4, EndPoint=cull_i_3)
len_2 = Length(Curve=ln)
unflatten = UnflattenTree(Tree=ma.PartialResults, Guide=multiplication_5)

# ---- group: retraction
item_3 = ListItem(List=unflatten, Index=0, Wrap=True)  # -> Item1, Item
subtraction_2 = Subtraction(A=item_3.Item1, B=python_9)
expression_2 = Expression(x=subtraction_2, Expression="Round(x,4)")
format = Format(Format="G1 F2400 E{0}", Culture=127, Data0=expression_2)
gate = StreamGate(Stream=format, Gate=python_14)  # -> Target0, Target1

# ---- group: pre-extrude
num_6 = Number("0.02")
entwine = Entwine(Branch00=num_6, Branch01=item_3.Item1, FlattenInputs=True)  # -> flatten(Result)
cull_i_5 = CullIndex(List=entwine, Indices="-1", Wrap=True)
unflatten_2 = UnflattenTree(Tree=cull_i_5, Guide=item_3.Item1)
expression_3 = Expression(x=unflatten_2, Expression="Round(x,4)")
format_2 = Format(Format="G1 F3600 E{0}", Culture=127, Data0=expression_3)

# ----
ma_2 = MassAddition(Input=len_2)  # -> Result, PartialResults
division_3 = Division(A=len, B=python_16)  # -> flatten(Result)

# ---- group: print
expression_4 = Expression(x=pdecon_2.XComponent, Expression="Round(x,3)")
expression_5 = Expression(x=pdecon_2.YComponent, Expression="Round(x,3)")
expression_6 = Expression(x=unflatten, Expression="Round(x,4)")
format_3 = Format(
    Format="G1 F{0} X{1} Y{2} E{3}",
    Culture=127,
    Data0=python_16,
    Data1=expression_4,
    Data2=expression_5,
    Data3=expression_6)

# ----
ma_3 = MassAddition(Input=division_3)  # -> Result, PartialResults
division_4 = Division(A=ma_2.Result, B=multiplication_4)

# ---- group: lift
addition_3 = Addition(A=pdecon.ZComponent, B=python_7)
format_4 = Format(Format="G0 F3600 Z{0}", Culture=127, Data0=pdecon.ZComponent)

# ---- group: travel
expression_7 = Expression(x=pdecon.XComponent, Expression="Round(x,3)")
expression_8 = Expression(x=pdecon.YComponent, Expression="Round(x,3)")
format_5 = Format(
    Format="G0 F{0} X{1} Y{2} Z{3}",
    Culture=127,
    Data0=multiplication_4,
    Data1=expression_7,
    Data2=expression_8,
    Data3=addition_3)

# ----
addition_4 = Addition(A=division_4, B=ma_3.Result)

# ---- group: print
ins_2 = InsertItems(List=format_3, Item=gate.Target1, Indices="-1", Wrap=True)
clean = CleanTree(RemoveNulls=True, RemoveInvalid=True, RemoveEmpty=True, Tree=ins_2)

# ----
panel = Panel("""PRINT_START EXTRUDER={1} BED={0}
G92 E0
M82
G1 E-0.1 F3600""")
panel_2 = Panel("""M109 S150
M190 S{0}
G92 E0
G28
G28 Z
M109 S{1}
G90
M82
M107
G92 E0
M201 X10000 Y10000 Z3000
G0 X20 Y5 Z0.2 F3600
G1 X220 F3600 E15
G0 Y5.4 F3600
G1 X20 F3000 E30
G0 Z5 F3000
G92 E0
G1 E-0.1 F3600""")
format_6 = Format(Format=panel_2, Culture=127, Data0=python_10, Data1=python_5)

panel_3 = Panel("""0
2
3""")
panel_4 = Panel("""0
1
2
3""")
filter_2 = StreamFilter(Gate=python_15, Stream0=panel_3, Stream1=panel_4)
panel_5 = Panel("""M400
G92 E0
G1 E-10.0 F3600
G91
G0 Z1.0 X20.0 Y20.0 F20000
M104 S0
M140 S0
M107
G1 Z15 F3000
G90""")
weave = Weave(Pattern=filter_2, Stream0=format_5, Stream1=format_4, Stream2=format_2, Stream3=clean, NullGaps=False)
format_7 = Format(Format=panel, Culture=127, Data0=python_10, Data1=python_5)
flatten_2 = FlattenTree(Tree=weave, Path="{0}")
filter_3 = StreamFilter(Gate=python_8, Stream0=panel_5, Stream1="PRINT_END")
filter_4 = StreamFilter(Gate=python_8, Stream0=format_6, Stream1=format_7)
lng_2 = ListLength(List=cset.Set)
entwine_2 = Entwine(Branch00=filter_4, Branch01=flatten_2, Branch02=filter_3, FlattenInputs=True)  # -> flatten(Result)
rec = Rectangle(rectangle.Rectangle)
crv_2 = Curve(flatten)
crv_3 = Curve(ln)
int_9 = Integer(lng_2)
num_7 = Number(addition_4)
platform = ClusterOutput(rec)
printing_path = ClusterOutput(crv_2)
travel_path = ClusterOutput(crv_3)
gcode = ClusterOutput(entwine_2)  # Output Gcode for 3D printing
layer_count = ClusterOutput(int_9)
printing_time = ClusterOutput(num_7)

# ==== cluster ExportGcode: Input Gcode text, save address, and file name, click the button to export the Gcode file. If use Mac, please add "/" end of the address.
gcode_text = ClusterInput()  # Input Gcode text
confirm_export = ClusterInput()  # Confirm export Gcode
path_folder = ClusterInput()  # Export address
file_name = ClusterInput()  # File name
txt = Text(path_folder)
txt_2 = Text(file_name)
bool = Boolean(confirm_export)
txt_3 = Text(gcode_text)
export = ExportFile(gcode=txt_3, path=txt, name=txt_2, update=bool)  # inputs gcode: list, update: Boolean
# ---------- export: Python ----------
__author__ = "littlechao PC"
__version__ = "2023.07.08"

import rhinoscriptsyntax as rs

if name is None:
    name = 'gh_gcode'

file = '\{n}.gcode'.format(n=name)
path = path + file
if update is True:
    with open(path, 'w') as f:
        for line in gcode:
            f.writelines(line)
            f.write('\n')
# ---------- end export ----------

# ==== cluster LocalPathOptimization: Input a list of curves, optimize their order and then output the optimized curves as a list
curves = ClusterInput()  # Input curve as list
crv = Curve(curves)
local_road_optimization = LocalRoadOptimization(crv=crv)  # -> opti_curve, min_distance; inputs crv: list of Curve
# ---------- local_road_optimization: Python ----------
import rhinoscriptsyntax as rs

def optimize(crv):
    length = len(crv)
    
    # 预先计算每条曲线的起点和终点
    start_points = [rs.CurveStartPoint(c) for c in crv]
    end_points = [rs.CurveEndPoint(c) for c in crv]
    
    for num in range(length - 1):
        current_end_pt = end_points[num]
        closest_index = num + 1
        min_distance = rs.Distance(current_end_pt, start_points[closest_index])
        
        # 查找最近的曲线
        for i in range(num + 2, length):
            distance = rs.Distance(current_end_pt, start_points[i])
            if distance < min_distance:
                min_distance = distance
                closest_index = i
        
        # 交换位置
        if closest_index != num + 1:
            crv[num + 1], crv[closest_index] = crv[closest_index], crv[num + 1]
            start_points[num + 1], start_points[closest_index] = start_points[closest_index], start_points[num + 1]
            end_points[num + 1], end_points[closest_index] = end_points[closest_index], end_points[num + 1]
    
    return crv

def calculate_empty_road_length(crv):
    empty_len = 0
    for i in range(len(crv) - 1):
        empty_len += rs.Distance(rs.CurveEndPoint(crv[i]), rs.CurveStartPoint(crv[i + 1]))
    return empty_len




# 优化曲线排列
travel_len = calculate_empty_road_length(crv)
optimized_curves = optimize(crv)
opti_travel_len = calculate_empty_road_length(optimized_curves)

# 输出结果
opti_curve = optimized_curves
min_distance = [travel_len, opti_travel_len]
# ---------- end local_road_optimization ----------
crv_2 = Curve(local_road_optimization.opti_curve)
num = Number(local_road_optimization.min_distance)
travel_distance = ClusterOutput(num)  # Original and optimized travel distances
curves_2 = ClusterOutput(crv_2)  # Output optimized curves as list

# ==== cluster MultiLayer: Generate multi-layer paths as tree list
layer_count = ClusterInput()  # The number of the layer
layer_thickness = ClusterInput()  # Other layer thickness
curves = ClusterInput()  # Input curves
first_layer_thickness = ClusterInput()  # First layer thickness
top_layer_thickness = ClusterInput()  # Top layer thickness
int = Integer(layer_count)
num = Number(top_layer_thickness)
num_2 = Number(layer_thickness)
num_3 = Number(first_layer_thickness)
crv = Curve(curves)
series = Series(Start=num_3, Step=num_2, Count=int)
python = GhPythonScript(x=num_2, y=num)  # -> a
# ---------- python: Python ----------
if y is None or y == 0:
    y = x

a = y
# ---------- end python ----------
lng = ListLength(List=series)
item = ListItem(List=series, Index="-2", Wrap=True)
subtraction = Subtraction(A=lng, B="1")
addition = Addition(A=item, B=python)
subtraction_2 = Subtraction(A=int, B="1")
replace = ReplaceItems(List=series, Item=addition, Indices=subtraction, Wrap=False)
bool = Boolean(subtraction_2)
filter = StreamFilter(Gate=bool, Stream0=series, Stream1=replace)
Z = UnitZ(Factor=filter)  # -> graft(UnitVector)
move = Move(Geometry=crv, Motion=Z)  # -> Geometry, Transform
crv_2 = Curve(move.Geometry)
curve = ClusterOutput(crv_2)  # Output curve list

# ==== cluster WavyStructure: Input a contour curve, output the wavy structure as curves
contour_curve = ClusterInput()  # Input a contour curve
tc = ClusterInput()
crv = Curve(contour_curve)
brep = Brep(crv)
qrsettings = QuadRemeshSettings(TargetCount=tc, AdaptiveSize=0, AdaptiveCount=False, HardEdges=False, SeamEdges=0, Symmetry=0, GuideCurves=0)
qrmesh = QuadRemesh(Mesh=brep, Settings=qrsettings)

# ---- group: 纹理
mesh = Mesh(qrmesh)
faceb = FaceBoundaries(Mesh=mesh)
crv_2 = Curve([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])
cpoly = ControlPolygon(Curve=crv_2)  # -> Polygon, flatten(Points)
medges = MeshEdges(Mesh=mesh)  # -> NakedEdges, InteriorEdges, NonManifoldEdges
bnd = Bounds2D(Coordinates=cpoly.Points)
dedom2 = DeconstructDomain²(Domain=bnd)  # -> UComponent, VComponent
rectangle = Rectangle(Plane=PlaneXY(0, 0, 0), XSize=dedom2.UComponent, YSize=dedom2.VComponent, Radius=0)  # -> Rectangle, Length
map_srf = MapToSurface(Curve=crv_2, Source=rectangle.Rectangle, Target=graft(faceb))  # -> flatten(Curve)
join = JoinCurves(Curves=medges.NakedEdges, Preserve=False)
join_2 = JoinCurves(Curves=map_srf, Preserve=False)
merge = Merge(Data1=join, Data2=join_2)
crv_3 = Curve(merge)

# ----
output_curve_texture = ClusterOutput(crv_3)  # Curves as list

# ==== cluster CustomTexture: Input a contour curve and curves as texture unit, output textures
contour_curve = ClusterInput()  # Input a contour curve
target_count = ClusterInput()  # Number of quads for aim in the result
attractive_point = ClusterInput()  # Input attractive points
factor = ClusterInput()  # Attractive factor from 0 to 1
unit_texture = ClusterInput()  # Input curves as unit texture
rotate_texture = ClusterInput()  # 0 is default, 1 is 90, 2 is 180
cluster = Cluster(contour_curve=contour_curve, target_count=target_count, attractive_point=attractive_point, factor=factor)

# ---- group: 纹理
int = Integer(rotate_texture)
mesh = Mesh(cluster)
crv = Curve(unit_texture)
python = GhPythonScript(x=int)  # -> a
# ---------- python: Python ----------
if x is None:
    x = 0
a = x
# ---------- end python ----------
faceb = FaceBoundaries(Mesh=mesh)
multiplication = Multiplication(A=python, B="0.5")
pi = Pi(Factor=multiplication)
rotate = Rotate(Geometry=crv, Angle=pi, Plane=PlaneXY(0, 0, 0))  # -> Geometry, Transform
medges = MeshEdges(Mesh=mesh)  # -> NakedEdges, InteriorEdges, NonManifoldEdges
bbox = BoundingBox(Content=rotate.Geometry, Plane=PlaneXY(0, 0, 0), UnionBox=True)  # -> Box, Box_2
debox = DeconstructBox(Box=bbox.Box)  # -> Plane, X, Y, Z
rectangle = Rectangle(Plane=PlaneXY(0, 0, 0), XSize=debox.X, YSize=debox.Y, Radius=0)  # -> Rectangle, Length
map_srf = MapToSurface(Curve=rotate.Geometry, Source=rectangle.Rectangle, Target=graft(faceb))  # -> flatten(Curve)
join = JoinCurves(Curves=medges.NakedEdges, Preserve=False)
join_2 = JoinCurves(Curves=map_srf, Preserve=False)
merge = Merge(Data1=join, Data2=join_2)
crv_2 = Curve(merge)

# ----
output_curve_texture = ClusterOutput(crv_2)  # Curves as list

# ==== cluster Cluster
contour_curve = ClusterInput()  # Input a contour curve
target_count = ClusterInput()  # Number of quads for aim in the result
attractive_point = ClusterInput()  # Input attractive points
factor = ClusterInput()  # Attractive factor from 0 to 1
crv = Curve(contour_curve)
int = Integer(target_count)
pt = Point(attractive_point)
brep = Brep(crv)
num = Number(factor)
qrsettings = QuadRemeshSettings(TargetCount=int, AdaptiveSize=0, AdaptiveCount=False, HardEdges=False, SeamEdges=0, Symmetry=0, GuideCurves=0)
qrmesh = QuadRemesh(Mesh=brep, Settings=qrsettings)
medges = MeshEdges(Mesh=qrmesh)  # -> NakedEdges, InteriorEdges, NonManifoldEdges
demesh = DeconstructMesh(Mesh=qrmesh)  # -> Vertices, Faces, Colours, Normals
join = JoinCurves(Curves=medges.NakedEdges, Preserve=False)
ln = Line(StartPoint=demesh.Vertices, EndPoint=graft(pt))
python = GhPythonScript(x=pt)  # -> a; inputs x: list of Point3d
# ---------- python: Python ----------
if len(x) == 0:
    a = False
else:
    a = True
# ---------- end python ----------
pull = PullPoint(Point=demesh.Vertices, Geometry=join, ClosestOnly=True)  # -> ClosestPoint, Distance
flip = FlipMatrix(Data=ln)
bnd = Bounds(Numbers=pull.Distance)
len = Length(Curve=flip)
remap = RemapNumbers(Value=pull.Distance, Source=bnd, Target=Domain(0, 1))  # -> Mapped, Clipped
sort = SortList(Keys=len, ValuesA=flip)  # -> Keys, ValuesA
graph = GraphMapper(remap.Mapped, x0=0, x1=1, y0=0, y1=1, container_name="Bezier", cpx=[0, 0, 0.6231879592, 1], cpy=[0, 0.4149753451, 1, 1])
item = ListItem(List=sort.ValuesA, Index=0, Wrap=True)
trim = TrimTree(Tree=item, Depth=1)
multiplication = Multiplication(A=remap.Mapped, B=num)
python_2 = GhPythonScript(x=remap.Mapped, y=multiplication)  # -> out, a
# ---------- python_2: Python ----------
if x > 0.001:
    a = y
else:
    a = 0
# ---------- end python_2 ----------
eval = EvaluateCurve(Curve=reparameterize(trim), Parameter=python_2.a)  # -> Point, Tangent, Angle
eval_2 = EvaluateCurve(Curve=reparameterize(flip), Parameter=graft(python_2.a))  # -> Point, Tangent, Angle
avr = Average(Input=eval_2.Point)  # -> flatten(ArithmeticMean)
ln_2 = Line(StartPoint=eval.Point, EndPoint=avr)
midpt = CurveMiddle(Curve=ln_2)
conmesh = ConstructMesh(Vertices=midpt, Faces=demesh.Faces)
filter = StreamFilter(Gate=python, Stream0=qrmesh, Stream1=conmesh)
mesh = Mesh(filter)
quad_mesh = ClusterOutput(mesh)  # Output quad mesh
